# Requirement set Missile_Reqs (R2025b)

## 1 [RFP] Cost
Missile Cost will be less than $500,000

## 2 [RFP] Range
The range will be 500 nm from its launch to impact

## 3 [RFP] Cruise Speed
The missile must have a minimum cruise speed above Mach 3.

## 4 [RFP] Mark 41 VLS
Missile must be able to launch from Mark 41 VLS, Launch weight is less than 5000 lbm

## 5 [RFP] Land Based Launch (HIMARS)
The missile must be able to be launched from Mobile land-based launchers (ie, HIMRAS, MLRS). Launch weight < 2000 lbm.

## 6 [RFP] External Fighter
Missile must launch form an external fighter hard point. Launch weight < 2000 lbm.

## 7 [RFP] Submarine
Missile must launch from a submarine tube. Launch weight < 3500 lbm.

## 8 [RFP] Internal Fighter
Must launch from a figher internal carriage. Launch weight < 2000 lbm.

## 9 [RFP] Dimensions
Missile fits in a 15 x 15 x 144 in box.

## 10 [RFP]

## 11 [RFP]

## 12 [RFP]

## 13 [RFP]

## 14 [RFP]

## 15 [RFP]

## 16 [RFP]

## 17 [RFP]

## 18 [#18]

## 19 [#19]

## 20 [#20]

## 21 [#21]

## 22 [#22]

## 23 [#23]

## 24 [#24]

## 25 [#25]

## 26 [#26]

## 27 [#27]

## 28 [#28]

## 29 [#29]

## 30 [#30]

## 31 [#31]

## 32 [#32]

## 33 [#33]

## 34 [#34]